# Grasshopper definition 2_basic_slicing_example.gh (Grasshopper 1.0.7)

# ---- group: Curves from Json
py = PythonScript()  # -> path
# ---------- py: Python ----------
import sys
import os

ghComp = ghenv.Component
ghDoc = ghComp.OnPingDocument()

# the full path of the gh file
path = ghDoc.FilePath
# the directory of the gh file
path = os.path.dirname(path)

#path = os.path.abspath(os.path.join(path, ".."))

print path
# ---------- end py ----------
python = GhPythonScript(recompute=Button(), path=py, name="vase_contours.json")  # -> out, curves, all_pts
# ---------- python: Python ----------
import os
import json
import rhinoscriptsyntax as rs
import utils_compas as utils
utils = reload(utils)

filename =os.path.join(os.path.join(path, "..") +'\data',name)

with open(filename, 'r') as f:
    data = json.load(f)
print("Loaded Json: " + filename)
    
curves = []
all_pts = []

for i in range(len(data)):
    print (i)
    pts = data[str(i)]
    polyline = rs.AddPolyline(pts)
    curves.append(polyline)
# ---------- end python ----------
crv = Curve(python.curves)
pt = Point(python.all_pts)

# ----
disc = Discontinuity(Curve=crv, Level=1)  # -> Points, Parameters
preview = CustomPreview(Geometry=crv, Material=ColourSwatch(SwatchColor=RGB(189, 189, 189)))
end = EndPoints(Curve=crv)  # -> Start, End
