# Grasshopper definition curved_slicing_master.gh (Grasshopper 1.0.7)
# plug-ins: Human

# ---- group: folders
data_folder_name = Panel("data_vase\")
data_folder_name_2 = Panel("data_Y_shape\")
data_folder_name_3 = Panel("data_costa_surface\")

# ---- group: Select example
list = ValueList({"Vase": 0, "Y shape": 1, "Costa surface": 2}, selected="Y shape")

# ----
merge = Merge(Data1=flatten(data_folder_name), Data2=flatten(data_folder_name_2), Data3=flatten(data_folder_name_3))
item = ListItem(List=merge, Index=list, Wrap=True)

# ----
# Input
# Inputs
py = PythonScript()  # -> path
# ---------- py: Python ----------
import sys
import os

ghComp = ghenv.Component
ghDoc = ghComp.OnPingDocument()

# the full path of the gh file
path = ghDoc.FilePath
# the current directory 
path = os.path.abspath(os.path.join(path, ".."))

print path
# ---------- end py ----------

# ---- group: Folder name
data = Data(item)

# ----
load_mesh = GhPythonScript(recompute=Button(), path=py, folder=data, filename="mesh.obj")  # -> out, mesh
# ---------- load_mesh: Python ----------
__author__ = "ioanna"

import os
import Rhino.Geometry as rg
import rhinoscriptsyntax as rs
from compas.datastructures import Mesh
from compas_ghpython.artists import MeshArtist
from compas.geometry import Frame
from compas_ghpython.utilities import list_to_ghtree


vertices = []
faces = []

for line in open(os.path.join(path, folder, filename), "r"):
    if line.startswith('#'): 
        continue
    values = line.split()
    if not values: 
        continue
        
    if values[0] == 'v':
        v = map(float, values[1:4])
        vertices.append(v)
    elif values[0] == 'f':
        face = []
        for v in values[1:]:
            w = v.split('/')
            face.append(int(w[0]))
        faces.append(face)
        
print('Vertices : ', len(vertices))    
print('Faces : ', len(faces))


mesh = rg.Mesh()

for v in vertices:
    mesh.Vertices.Add(v[0], v[1], v[2]);
for i, f in enumerate(faces):
    mesh.Faces.AddFace(f[0]-1, f[1]-1, f[2]-1);
    



#mesh = Mesh.from_vertices_and_faces(vertices, faces)
#mesh = Mesh.from_obj(os.path.join(path, folder, 'output', filename))


#print (len(list(mesh.vertices())))
#artist = MeshArtist(mesh)
#mesh = artist.draw()
# ---------- end load_mesh ----------

# ---- group: Input mesh
mesh = Mesh(load_mesh.mesh)

# ----
# Load Printpoints
panel = Panel("out_printpoints")
button = Button()
csfindfilenames = CsFindFilenames(recompute=button, starts_with=panel, ends_with="json", path=py, folder_name=data)  # -> out, filenames, n; inputs recompute: Boolean
# ---------- csfindfilenames: Python ----------
"""
Finds all the filenames from the output directory that have the specified name. 

"""

import compas_slicer_ghpython.visualization as gh_compas_slicer
gh_compas_slicer = reload(gh_compas_slicer)
import os

if starts_with and ends_with and path and folder_name:
    filenames = gh_compas_slicer.get_files_with_name(starts_with, ends_with, os.path.join(path, folder_name, 'output'))
    n = len(filenames)
else:
    gh_compas_slicer.missing_input()
# ---------- end csfindfilenames ----------
csloadprintpoints = CsLoadPrintpoints(recompute=button, json_name=csfindfilenames.filenames, path=py, folder_name=data)  # -> out, geometry, points, frames, layer_heights, up_vectors, mesh_normals, closest_support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; inputs recompute: Boolean
# ---------- csloadprintpoints: Python ----------
"""
Loads a dictionaly of Printpoints from a json file in the 'output' folder.

"""

import compas_slicer_ghpython.visualization as gh_compas_slicer
gh_compas_slicer = reload(gh_compas_slicer)


if path and folder_name and json_name:
    points, frames, layer_heights, up_vectors, mesh_normals, closest_support, velocities, wait_times, \
    blend_radiuses, extruder_toggles = \
        gh_compas_slicer.load_printpoints(path, folder_name, json_name)
    
else:
    gh_compas_slicer.missing_input()
# ---------- end csloadprintpoints ----------

# ----
# Results
# Load Slicer
button_2 = Button()
csfindfilenames_2 = CsFindFilenames(recompute=button_2, starts_with="curved_slicer", ends_with=".json", path=py, folder_name=data)  # -> out, filenames, n; inputs recompute: Boolean; same code as csfindfilenames
csloadslicer = CsLoadSlicer(recompute=button_2, json_name=csfindfilenames_2.filenames, path=py, folder_name=data)  # -> out, mesh, paths, are_closed, all_points; inputs recompute: Boolean
# ---------- csloadslicer: Python ----------
"""
Loads a Slicer class from its json file in the 'output' folder.

"""

import compas_slicer_ghpython.visualization as gh_compas_slicer
gh_compas_slicer = reload(gh_compas_slicer)


if path and folder_name and json_name:
    mesh, paths, are_closed, all_points = gh_compas_slicer.load_slicer(path, folder_name, json_name)
else:
    gh_compas_slicer.missing_input()
# ---------- end csloadslicer ----------

# ----
# Create boundary vertices file (json)
mesh_2 = Mesh(mesh)

# ---- group: Path cross-section
# Visualization
xz = XZPlane(Origin=Point(0, 0, 0))
rectangle = Rectangle(Plane=xz, XSize=Slider(2.5, range=0..10), YSize=Slider(1, range=0..10), Radius=Slider(0.43, range=0..1))  # -> Rectangle, Length

# ----
medges = MeshEdges(Mesh=mesh_2)  # -> NakedEdges, InteriorEdges, NonManifoldEdges

# ----
# Debugging
# Single distance list
button_3 = Button()
offset = Slider(47.4, range=0..200)
csloadjsondata = CsLoadJsonData(recompute=button_3, json_name="distances_LOW.json", path=py, folder_name=data)  # -> out, data; inputs recompute: Boolean
# ---------- csloadjsondata: Python ----------
"""Loads a json file from the output folder. """

import compas_slicer_ghpython.visualization as gh_compas_slicer
gh_compas_slicer = reload(gh_compas_slicer)

if json_name and path and folder_name:
    data = gh_compas_slicer.load_json_file(path, folder_name, json_name)
else:
    gh_compas_slicer.missing_input()
# ---------- end csloadjsondata ----------
bnd = Bounds(Numbers=csloadjsondata.data)
bounds = Panel(bnd)
olffset = GhPythonScript(values=csloadjsondata.data, offset=offset)  # -> a; inputs values: list
# ---------- olffset: Python ----------
a = [v-offset for v in values]
# ---------- end olffset ----------

join = JoinCurves(Curves=flatten(medges.NakedEdges), Preserve=False)

# ----
# Simple interpolation
panel_2 = Panel("distances_HIGH.json")
weight = Slider(0.43, range=0..1)
csinterpolation = CsInterpolation(recompute=Button(), json_name1="distances_LOW.json", json_name2=panel_2, weight=weight, path=py, folder_name=data)  # -> out, interpolation; inputs recompute: Boolean
# ---------- csinterpolation: Python ----------
"""
Interpolation of the two distance fields that are loaded from the 'output' folder. 

"""

import compas_slicer_ghpython.visualization as gh_compas_slicer
gh_compas_slicer = reload(gh_compas_slicer)

if json_name1 and json_name2 and path and folder_name:
    interpolation = gh_compas_slicer.distance_fields_interpolation(path, folder_name, json_name1, json_name2, weight)
else:
    gh_compas_slicer.missing_input()
# ---------- end csinterpolation ----------

item_2 = ListItem(List=flatten(join), Index=0, Wrap=True)  # -> Item, Item1, Item2
demesh = DeconstructMesh(Mesh=mesh_2)  # -> Vertices, Faces, Colours, Normals

crv = Curve([item_2.Item, item_2.Item1])
crv_2 = Curve(item_2.Item2)

curve_display = CSharpScript(Curve=[crv, crv_2], Width=Slider(7.82, range=0..20), Colour=ColourSwatch(SwatchColor=RGB(135, 26, 26)))  # inputs Curve: Curve, Width: Int32, Colour: Color, Dash: String
# ---------- curve_display: C# ----------
    if (Curve == null) return;
    if (Width <= 0) return;

    double[] pattern = ParseDashPattern(Dash);
    IEnumerable<Curve> segments = ApplyDashPattern(Curve, pattern);

    _clip = BoundingBox.Union(_clip, Curve.GetBoundingBox(false));
    foreach (Curve segment in segments)
    {
      _curves.Add(segment);
      _colors.Add(Colour);
      _widths.Add(Width);
    }
# ---------- curve_display: C# additional code ----------
  /// <summary>
  /// Parse a dash pattern.
  /// </summary>
  /// <param name="pattern">Pattern to parse.</param>
  /// <returns>Array of dashes and gaps.</returns>
  private double[] ParseDashPattern(string pattern)
  {
    if (string.IsNullOrWhiteSpace(pattern))
      return null;

    string[] fragments = pattern.Split(new char[] {' '});
    if (fragments == null || fragments.Length == 0)
      return null;

    double[] values = new double[fragments.Length];
    for (int i = 0; i < fragments.Length; i++)
    {
      double v;
      if (!double.TryParse(fragments[i], out v))
        throw new Exception(fragments[i] + " is a not a valid number.");

      if (v <= 0.0)
        throw new Exception("Dashes or gaps must have a strictly positive length.");

      values[i] = v;
    }

    return values;
  }
  /// <summary>
  /// Apply a dash+gap pattern to a curve.
  /// </summary>
  private IEnumerable<Curve> ApplyDashPattern(Curve curve, double[] pattern)
  {
    if (pattern == null || pattern.Length == 0)
      return new Curve[] { curve };

    double curveLength = curve.GetLength();
    List<Curve> dashes = new List<Curve>();

    double offset0 = 0.0;
    int index = 0;
    while(true)
    {
      // Get the current dash length.
      double dashLength = pattern[index++];
      if (index >= pattern.Length)
        index = 0;

      // Compute the offset of the current dash from the curve start.
      double offset1 = offset0 + dashLength;
      if (offset1 > curveLength)
        offset1 = curveLength;

      // Solve the curve parameters at the current dash start and end.
      double t0, t1;
      curve.LengthParameter(offset0, out t0);
      curve.LengthParameter(offset1, out t1);

      Curve dash = curve.Trim(t0, t1);
      if (dash != null)
        dashes.Add(dash);

      // Get the current gap length.
      double gapLength = pattern[index++];
      if (index >= pattern.Length)
        index = 0;

      // Set the start of the next dash to be the end of the current
      // dash + the length of the adjacent gap.
      offset0 = offset1 + gapLength;

      // Abort when we've reached the end of the curve.
      if (offset0 >= curveLength)
        break;
    }

    return dashes;
  }

  private BoundingBox _clip;
  private readonly List<Curve> _curves = new List<Curve>();
  private readonly List<Color> _colors = new List<Color>();
  private readonly List<int> _widths = new List<int>();

  /// <summary>
  /// This method will be called once every solution, before any calls to RunScript.
  /// </summary>
  public override void BeforeRunScript()
  {
    _clip = BoundingBox.Empty;
    _curves.Clear();
    _colors.Clear();
    _widths.Clear();
  }

  /// <summary>
  /// Return a BoundingBox that contains all the geometry you are about to draw.
  /// </summary>
  public override BoundingBox ClippingBox
  {
    get { return _clip; }
  }
  /// <summary>
  /// Draw all wires and points in this method.
  /// </summary>
  public override void DrawViewportWires(IGH_PreviewArgs args)
  {
    for (int i = 0; i < _curves.Count; i++)
      args.Display.DrawCurve(_curves[i], _colors[i], _widths[i]);
  }
# ---------- end curve_display ----------

pull = PullPoint(Point=demesh.Vertices, Geometry=crv_2, ClosestOnly=True)  # -> ClosestPoint, Distance
dist = Distance(PointA=demesh.Vertices, PointB=pull.ClosestPoint)
smaller = SmallerThan(FirstNumber=dist, SecondNumber="0.001")  # -> SmallerThan, OrEqualTo
index = ItemIndex(List=demesh.Vertices, Item=demesh.Vertices)
dispatch = Dispatch(List=index, DispatchPattern=smaller.SmallerThan)  # -> ListA, ListB
dispatch_2 = Dispatch(List=demesh.Vertices, DispatchPattern=smaller.SmallerThan)  # -> ListA, ListB
pt = Point(dispatch_2.ListA)
int = Integer(dispatch.ListA)

pull_2 = PullPoint(Point=demesh.Vertices, Geometry=crv, ClosestOnly=True)  # -> ClosestPoint, Distance
dist_2 = Distance(PointA=demesh.Vertices, PointB=pull_2.ClosestPoint)
smaller_2 = SmallerThan(FirstNumber=dist_2, SecondNumber="0.001")  # -> SmallerThan, OrEqualTo
index_2 = ItemIndex(List=demesh.Vertices, Item=demesh.Vertices)
dispatch_3 = Dispatch(List=index_2, DispatchPattern=smaller_2.SmallerThan)  # -> ListA, ListB
dispatch_4 = Dispatch(List=demesh.Vertices, DispatchPattern=smaller_2.SmallerThan)  # -> ListA, ListB
pt_2 = Point(dispatch_4.ListA)
int_2 = Integer(dispatch_3.ListA)

paths = Curve(simplify(csloadslicer.paths))
all_points = Point(csloadslicer.all_points)
mesh_3 = Mesh(csloadslicer.mesh)

panel_3 = Panel(csloadslicer.out)
panel_4 = Panel(csloadprintpoints.out)

points = Point(csloadprintpoints.points)
frames = Plane(csloadprintpoints.frames)
up_vectors = Vector(csloadprintpoints.up_vectors)
mesh_normals = Vector(csloadprintpoints.mesh_normals)
cpts = Point(csloadprintpoints.closest_support)
layer_heights = Number(csloadprintpoints.layer_heights)

frames_2 = Plane(frames)
pflip = FlipPlane(Plane=frames_2, ReverseX=False, ReverseY=False, SwapAxes=True)

print_planes = Plane(pflip)
tool_mesh = Mesh(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)

# ----
# Tool Visualization
# Note: This is only an example. The actual tool orientation depends on the definition of the frame of your tool
number_slider = Slider(1104, range=0..2000)
tool_origin = Panel("""0
0
99.507""")
cstoolviz = CsToolViz(origin_coords=tool_origin, mesh=tool_mesh, planes=print_planes, index=number_slider)  # -> out, mesh, passed_path; inputs origin_coords: list, mesh: Mesh, planes: list, index: Int32
# ---------- cstoolviz: Python ----------
"""
Example visualization of tool motion during the print.

"""

import compas_slicer_ghpython.visualization as gh_compas_slicer
gh_compas_slicer = reload(gh_compas_slicer)

if origin_coords and mesh and planes and (index or index==0):
    mesh, passed_path = gh_compas_slicer.tool_visualization(origin_coords, mesh, planes, index)
else:
    gh_compas_slicer.missing_input()
# ---------- end cstoolviz ----------

mesh_normals_2 = Vector(mesh_normals)
points_2 = Point(points)
section = Curve(rectangle.Rectangle)

velocities = Number(csloadprintpoints.velocities)
wait_times = Number(csloadprintpoints.wait_times)
blend_radiuses = Number(csloadprintpoints.blend_radiuses)
extruder_toggles = Number(csloadprintpoints.extruder_toggles)

# ----
# Ligthweight Path Visualization
number_slider_2 = Slider(3.9, range=0..10)
extruder_toggles_2 = Number(extruder_toggles)
all_points_2 = Point(points)
cslightpathviz = CsLightPathViz(
    points=all_points_2,
    extruder_toggles=extruder_toggles_2,
    domain_start=Slider(0, range=0..100),
    domain_end=Slider(1263, range=0..2000),
    pipe_diameter=number_slider_2)  # -> out, print_path_pipes, travel_path_lines; inputs points: list of Point3d, extruder_toggles: list of Boolean, domain_start: Int32, domain_end: Int32
# ---------- cslightpathviz: Python ----------
"""
Creates a lightweight visualization of the print paths. Segments with extruder_toggle=True are visualized as pipes, 
segments with extruder_toggle=False are visualized as lines.
Loads files from the 'output' folder.

"""

import compas_slicer_ghpython.visualization as gh_compas_slicer
gh_compas_slicer = reload(gh_compas_slicer)

pipe_resolution = 14

if points:
    
    # assign default values to parameters where possible. 
    if not extruder_toggles:
        extruder_toggles = [False for i in range(len(points))]
    if not domain_start:
        domain_start = 0
    if not domain_end:
        domain_end = len(points)
    if not pipe_diameter:
        pipe_diameter = 2.0
        
    print_path_pipes, travel_path_lines = \
        gh_compas_slicer.lightweight_path_visualization(points, extruder_toggles, pipe_diameter, pipe_resolution)
    
else:
    gh_compas_slicer.missing_input()
# ---------- end cslightpathviz ----------

# ----
# Render Path Visualization
toggle = BooleanToggle(False)
extruder_toggles_3 = Number(extruder_toggles)
layer_heights_2 = Number(layer_heights)
up_vectors_2 = Vector(up_vectors)

python = CsRenderPathViz(
    points=points_2,
    mesh_normals=mesh_normals_2,
    layer_heights=layer_heights_2,
    up_vectors=up_vectors_2,
    extruder_toggles=extruder_toggles_3,
    cross_section=section,
    planar_printing=toggle,
    compute=Toggle(False))  # -> out, loft_surfaces, travel_path_lines; inputs points: list of Point3d, mesh_normals: list of Vector3d, layer_heights: list, up_vectors: list of Vector3d, extruder_toggles: list of Boolean, cross_section: Curve, planar_printing: Boolean, compute: Boolean
# ---------- python: Python ----------
"""
Creates a render visualization of the print paths with loft surfaces where extruder_toggle=True.
For large number of points, this can take a while to compute, so keep it turned off unless you need it.
Loads files from the 'output' folder.

"""

import compas_slicer_ghpython.visualization as gh_compas_slicer
gh_compas_slicer = reload(gh_compas_slicer)

pipe_resolution = 14

if points and mesh_normals and layer_heights and extruder_toggles and cross_section:
    if compute:
        loft_surfaces, travel_path_lines = \
            gh_compas_slicer.render_path_visualization(points, mesh_normals, layer_heights, up_vectors, extruder_toggles, cross_section, planar_printing)
    else:
        print('Compute is set to False')
else:
    gh_compas_slicer.missing_input()
# ---------- end python ----------

# ---- group: Color output
geo = Geometry(cslightpathviz.print_path_pipes)
geo_2 = Geometry(cslightpathviz.travel_path_lines)
preview = CustomPreview(Geometry=geo, Material=ColourSwatch(SwatchColor=RGB(199, 199, 199)))
preview_2 = CustomPreview(Geometry=geo_2, Material=ColourSwatch(SwatchColor=RGB(255, 156, 36)))

geo_3 = Geometry(python.travel_path_lines)
geo_4 = Geometry(python.loft_surfaces)
preview_3 = CustomPreview(Geometry=geo_4, Material=ColourSwatch(SwatchColor=RGB(222, 222, 222)))
preview_4 = CustomPreview(Geometry=geo_3, Material=ColourSwatch(SwatchColor=RGB(255, 156, 36)))

# ----
geo_5 = Geometry(cstoolviz.passed_path)
mesh_4 = Mesh(cstoolviz.mesh)
preview_5 = CustomPreview(Geometry=mesh_4, Material=ColourSwatch(SwatchColor=RGB(171, 171, 171)))
preview_6 = CustomPreview(Geometry=geo_5, Material=ColourSwatch(SwatchColor=RGB(255, 156, 36)))

# ----
# Visualize geodesic distances
distances = Number(olffset)
distances_2 = Number(csinterpolation.interpolation)

ln = Line(StartPoint=points, EndPoint=cpts)
vdis = VectorDisplay(Anchor=points, Vector=expr("x*5", up_vectors))
pline = PolyLine(Vertices=points, Closed=False)

# ---- group: Press button to save json files
button_4 = Button()

# ----
abs = Absolute(Value=distances_2)

# ---- group: Select parameter
num = Number(layer_heights)

# ---- group: Visualize distance values on mesh
distances_3 = Number(abs)
mesh_5 = Mesh(mesh)

# ---- group: Color per layer
tstat = TreeStatistics(Tree=paths)  # -> Paths, Length, Count
series = Series(Start=0, Step=1, Count=tstat.Count)
gradient = Gradient(
    LowerLimit="0",
    UpperLimit=tstat.Count,
    Parameter=series,
    stops=[0: RGB(234, 38, 0), 0.25: RGB(234, 126, 0), 0.5: RGB(254, 244, 84), 0.75: RGB(173, 203, 249), 1: RGB(75, 107, 169)])
data_2 = Data(graft(gradient))
previewlw = CustomPreviewLineweights(Geometry=paths, Shader=data_2, Thickness=Slider(2.89, range=0..10), Absolute=False)

# ---- group: Visualize parameter with text
tag_offset = Slider(1, range=0..100)
pdecon = Deconstruct(Point=points)  # -> XComponent, YComponent, ZComponent
addition = Addition(A=pdecon.ZComponent, B=tag_offset)
pt_3 = ConstructPoint(XCoordinate=pdecon.XComponent, YCoordinate=pdecon.YComponent, ZCoordinate=addition)
tag = TextTag(Location=pt_3, Text=num, Colour=ColourSwatch(SwatchColor=RGB(50, 130, 186)))

# ---- group: Visualize parameter with color
bnd_2 = Bounds(Numbers=num)
avr = Average(Input=num)
dedomain = DeconstructDomain(Domain=bnd_2)  # -> Start, End
average = Panel(avr)
gradient_2 = Gradient(
    LowerLimit=dedomain.Start,
    UpperLimit=dedomain.End,
    Parameter=num,
    stops=[0: RGB(0, 128, 0), 0.5: RGB(255, 255, 0), 1: RGB(255, 0, 0)])
pt_4 = Point(points)
cloud = CloudDisplay(Points=pt_4, Colours=gradient_2, Size=Slider(1.72, range=0..10), SpriteType=1)

# ---- group: Visualize distance values on mesh
bnd_3 = Bounds(Numbers=distances_3)
dedomain_2 = DeconstructDomain(Domain=bnd_3)  # -> Start, End
gradient_3 = Gradient(
    LowerLimit=dedomain_2.Start,
    UpperLimit=dedomain_2.End,
    Parameter=distances_3,
    stops=[0: RGB(0, 128, 0), 0.0566: RGB(255, 255, 0), 0.915: RGB(255, 0, 0)])
demesh_2 = DeconstructMesh(Mesh=mesh_5)  # -> Vertices, Faces, Colours, Normals
conmesh = ConstructMesh(Vertices=demesh_2.Vertices, Faces=demesh_2.Faces, Colours=gradient_3)

# ---- group: Slicer data
len = Length(Curve=flatten(paths))
lng = ListLength(List=flatten(paths))
sum = GhPythonScript(x=len)  # -> out, a; inputs x: list
# ---------- sum: Python ----------
__author__ = "Ioanna"
__version__ = "2020.10.25"

import rhinoscriptsyntax as rs

a = 0
for v in x:
    a += v
# ---------- end sum ----------
total_path_length = Panel(sum.a)
total_number_of_paths = Panel(lng)

# ----
save_to_json = GhPythonScript(save=button_4, list=int_2, path=py, folder_name=data, json_name="boundaryHIGH.json")  # -> out; inputs save: Boolean, list: list
# ---------- save_to_json: Python ----------
"""
Saves to Json

"""

import compas_slicer_ghpython.visualization as gh_compas_slicer
gh_compas_slicer = reload(gh_compas_slicer)


if save:
    if list and path and folder_name and json_name:
        gh_compas_slicer.save_json_file(list, path, folder_name, json_name)
    else:
        gh_compas_slicer.missing_input()
else:
    print('No files were saved because save = False')
# ---------- end save_to_json ----------
save_to_json_2 = GhPythonScript(save=button_4, list=int, path=py, folder_name=data, json_name="boundaryLOW.json")  # -> out; inputs save: Boolean, list: list; same code as save_to_json
min = Panel(dedomain.Start)
max = Panel(dedomain.End)
panel_5 = Panel(save_to_json)
panel_6 = Panel(save_to_json_2)

# ----
# Load Vectors
panel_7 = Panel("gradient.json")
csloadjsonvectors = CsLoadJsonVectors(recompute=Button(), json_name=panel_7, path=py, folder_name=data)  # -> out, vectors; inputs recompute: Boolean
# ---------- csloadjsonvectors: Python ----------
"""
Loads a json file from the 'output' folder, 
that stores a vector field in the format: 
data['0']=[x0,y0,z0], ...,  data['N']=[xN,yN,zN]


"""

import compas_slicer_ghpython.visualization as gh_compas_slicer
gh_compas_slicer = reload(gh_compas_slicer)

if json_name and path and folder_name:
    vectors = gh_compas_slicer.load_json_vectors(path, folder_name, json_name)
else:
    gh_compas_slicer.missing_input()
# ---------- end csloadjsonvectors ----------
demesh_3 = DeconstructMesh(Mesh=mesh)  # -> Vertices, Faces, Colours, Normals
vdis_2 = VectorDisplay(Anchor=demesh_3.Vertices, Vector=csloadjsonvectors.vectors)

# ----
# Load Points
button_5 = Button()
csloadjsonpoints = CsLoadJsonPoints(recompute=button_5, json_name="pts_boundary_HIGH_0.json", path=py, folder_name=data)  # -> out, points; inputs recompute: Boolean
# ---------- csloadjsonpoints: Python ----------
"""
Loads a json file that stores a dictionary of N points in the format: 
data['0']=[x0,y0,z0], ...,  data['N']=[xN,yN,zN]


"""

import compas_slicer_ghpython.visualization as gh_compas_slicer
gh_compas_slicer = reload(gh_compas_slicer)

if json_name and path and folder_name:
    points = gh_compas_slicer.load_json_points(path, folder_name, json_name)
else:
    gh_compas_slicer.missing_input()
# ---------- end csloadjsonpoints ----------
pt_5 = Point(csloadjsonpoints.points)

# ----
# Find files by name
button_6 = Button()
csfindfilenames_3 = CsFindFilenames(recompute=button_6, starts_with="curved_slicer_", ends_with=".json", path=py, folder_name=data)  # -> out, filenames, n; inputs recompute: Boolean; same code as csfindfilenames
filenames = Panel(csfindfilenames_3.filenames)
number_of_files = Panel(csfindfilenames_3.n)

# ----
# Load BaseBoundaries
panel_8 = Panel("boundaries.json")

csloadjsonboundary = CsLoadJsonBoundary(recompute=Button(), json_name=panel_8, path=py, folder_name=data)  # -> out, points, vectors, n; inputs recompute: Boolean
# ---------- csloadjsonboundary: Python ----------
"""
Loads a json file that stores a dictionary of BaseBoundary classes in the format:
data['0']=base_boundary_1.to_data(), ..., data['N']=base_boundary_N.to_data()


"""

import compas_slicer_ghpython.visualization as gh_compas_slicer
gh_compas_slicer = reload(gh_compas_slicer)

if json_name and path and folder_name:
    points, vectors, n = gh_compas_slicer.load_base_boundaries(path, folder_name, json_name)
else:
    gh_compas_slicer.missing_input()
# ---------- end csloadjsonboundary ----------

no_of_boundaries = Panel(csloadjsonboundary.n)
vdis_3 = VectorDisplay(Anchor=csloadjsonboundary.points, Vector=expr("x*3", csloadjsonboundary.vectors))

# ----
# Load Polylines
button_7 = Button()

csloadjsonpolylines = CsLoadJsonPolylines(recompute=button_7, json_name="point_clusters_polylines_0.json", path=py, folder_name=data)  # -> out, polylines, points; inputs recompute: Boolean
# ---------- csloadjsonpolylines: Python ----------
"""
Loads a json file that stores a dictionary of N polylines in the format:
data['0']=points_dict_0, ..., data['N'] = points_dict_N, where points_dict is in the format:
points_dict['0']=[x0,y0,z0], ...,  points_dict['N']=[xN,yN,zN]


"""

import compas_slicer_ghpython.visualization as gh_compas_slicer
gh_compas_slicer = reload(gh_compas_slicer)

if json_name and path and folder_name:
    polylines, points = gh_compas_slicer.load_json_polylines(path, folder_name, json_name)
else:
    gh_compas_slicer.missing_input()
# ---------- end csloadjsonpolylines ----------

crv_3 = Curve(csloadjsonpolylines.polylines)

# ----
# Load Data
# Gradient norm
panel_9 = Panel("gradient_norm.json")
mesh_6 = Mesh(mesh)
demesh_4 = DeconstructMesh(Mesh=mesh_6)  # -> Vertices, Faces, Colours, Normals

csloadjsondata_2 = CsLoadJsonData(recompute=Button(), json_name=panel_9, path=py, folder_name=data)  # -> out, data; inputs recompute: Boolean; same code as csloadjsondata

data_3 = Data(csloadjsondata_2.data)
bnd_4 = Bounds(Numbers=data_3)
gradient_4 = Gradient(
    LowerLimit=Slider(0.1, range=0..0.1),
    UpperLimit=Slider(1, range=0..1),
    Parameter=data_3,
    stops=[0: RGB(234, 38, 0), 0.25: RGB(234, 126, 0), 0.5: RGB(254, 244, 84), 0.75: RGB(173, 203, 249), 1: RGB(75, 107, 169)])
avr_2 = Average(Input=data_3)
dedomain_3 = DeconstructDomain(Domain=bnd_4)  # -> Start, End
max_2 = Panel(dedomain_3.End)
min_2 = Panel(dedomain_3.Start)
average_2 = Panel(avr_2)
conmesh_2 = ConstructMesh(Vertices=demesh_4.Vertices, Faces=demesh_4.Faces, Colours=gradient_4)

# ----
# Load Data
# Load vertex indices
panel_10 = Panel("minima.json")
number_slider_3 = Slider(5.7, range=0..20)
demesh_5 = DeconstructMesh(Mesh=mesh)  # -> Vertices, Faces, Colours, Normals
merge_2 = Merge(Data1=panel_10, Data2="maxima.json", Data3="saddles.json")

csloadjsondata_3 = CsLoadJsonData(recompute=Button(), json_name=merge_2, path=py, folder_name=data)  # -> out, simplify(data); inputs recompute: Boolean; same code as csloadjsondata

branch = TreeBranch(Tree=csloadjsondata_3.data, Path="0", MaintainPaths=True)
branch_2 = TreeBranch(Tree=csloadjsondata_3.data, Path="1", MaintainPaths=True)
branch_3 = TreeBranch(Tree=csloadjsondata_3.data, Path="2", MaintainPaths=True)
item_3 = ListItem(List=demesh_5.Vertices, Index=branch, Wrap=True)
item_4 = ListItem(List=demesh_5.Vertices, Index=branch_2, Wrap=True)
item_5 = ListItem(List=demesh_5.Vertices, Index=branch_3, Wrap=True)
cloud_2 = CloudDisplay(Points=item_3, Colours=ColourSwatch(SwatchColor=RGB(107, 235, 52)), Size=number_slider_3, SpriteType=1)
cloud_3 = CloudDisplay(Points=item_4, Colours=ColourSwatch(SwatchColor=RGB(235, 52, 52)), Size=number_slider_3, SpriteType=1)
cloud_4 = CloudDisplay(Points=item_5, Colours=ColourSwatch(SwatchColor=RGB(18, 18, 18)), Size=number_slider_3, SpriteType=1)

# ----
# Load multiple meshes by name
button_8 = Button()

csloadmeshesbyname = CsLoadMeshesByName(recompute=button_8, starts_with="split_mesh_", ends_with=".obj", path=py, folder_name=data)  # -> out, loaded_meshes, number_of_meshes; inputs recompute: Boolean
# ---------- csloadmeshesbyname: Python ----------
"""
Loads all the meshes from the output directory that have the specified filename, and displays them with color.

"""

import compas_slicer_ghpython.visualization as gh_compas_slicer
gh_compas_slicer = reload(gh_compas_slicer)

if starts_with and ends_with and path and folder_name:
    loaded_meshes = gh_compas_slicer.load_multiple_meshes(starts_with, ends_with, path, folder_name)
    number_of_meshes = len(loaded_meshes)
else:
    gh_compas_slicer.missing_input()
# ---------- end csloadmeshesbyname ----------
mesh_7 = Mesh(csloadmeshesbyname.loaded_meshes)

medges_2 = MeshEdges(Mesh=csloadmeshesbyname.loaded_meshes)  # -> NakedEdges, InteriorEdges, NonManifoldEdges
number_of_meshes = Panel(csloadmeshesbyname.number_of_meshes)
crv_4 = Curve(medges_2.NakedEdges)
