# Grasshopper definition visualization_scalar_field_slicing.gh (Grasshopper 1.0.7)

mesh = Mesh(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)
tri = Triangulate(Mesh=mesh)  # -> Mesh, Count
weld = WeldMesh(Mesh=tri.Mesh, Angle=3.141592654)

# ---- group: FOLDER
data_folder_name = Panel("data\")

# ----
geometry_for_slicing = Mesh(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)
custom_base = Mesh(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)

# ----
# Inputs
# Output
py = PythonScript()  # -> path
# ---------- py: Python ----------
import sys
import os

ghComp = ghenv.Component
ghDoc = ghComp.OnPingDocument()

# the full path of the gh file
path = ghDoc.FilePath
# the current directory 
path = os.path.abspath(os.path.join(path, ".."))

print path
# ---------- end py ----------

# ---- group: Folder name
data = Data(data_folder_name)

# ---- group: Input mesh
mesh_2 = Mesh(geometry_for_slicing)

# ----
preview = CustomPreview(Geometry=custom_base, Material=ColourSwatch(SwatchColor=RGB(189, 189, 189)))
preview_2 = CustomPreview(Geometry=mesh_2, Material=ColourSwatch(SwatchColor=RGB(212, 212, 212)))

# ----
# Load Printpoints
panel = Panel("out_printpoints.json")
csloadprintpoints = CsLoadPrintpoints(recompute=Button(), json_name=panel, path=py, folder_name=data)  # -> out, geometry, points, frames, layer_heights, up_vectors, mesh_normals, closest_support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; inputs recompute: Boolean
# ---------- csloadprintpoints: Python ----------
"""
Loads a dictionaly of Printpoints from a json file in the 'output' folder.

"""

import compas_slicer_ghpython.visualization as gh_compas_slicer
gh_compas_slicer = reload(gh_compas_slicer)


if path and folder_name and json_name:
    points, frames, layer_heights, up_vectors, mesh_normals, closest_support, velocities, wait_times, \
    blend_radiuses, extruder_toggles = \
        gh_compas_slicer.load_printpoints(path, folder_name, json_name)
    
else:
    gh_compas_slicer.missing_input()
# ---------- end csloadprintpoints ----------

# ----
# Load Slicer
panel_2 = Panel("isocontours.json")
csloadslicer = CsLoadSlicer(recompute=Button(), json_name=panel_2, path=py, folder_name=data)  # -> out, mesh, paths, are_closed, all_points; inputs recompute: Boolean
# ---------- csloadslicer: Python ----------
"""
Loads a Slicer class from its json file in the 'output' folder.

"""

import compas_slicer_ghpython.visualization as gh_compas_slicer
gh_compas_slicer = reload(gh_compas_slicer)


if path and folder_name and json_name:
    mesh, paths, are_closed, all_points = gh_compas_slicer.load_slicer(path, folder_name, json_name)
    
else:
    gh_compas_slicer.missing_input()
# ---------- end csloadslicer ----------

# ---- group: Visualize distance field
csloadjsondata = CsLoadJsonData(recompute=Button(), json_name="distance_field.json", path=py, folder_name=data)  # -> out, data; inputs recompute: Boolean
# ---------- csloadjsondata: Python ----------
"""Loads a json file from the output folder. """

import compas_slicer_ghpython.visualization as gh_compas_slicer
gh_compas_slicer = reload(gh_compas_slicer)

if json_name and path and folder_name:
    data = gh_compas_slicer.load_json_file(path, folder_name, json_name)
else:
    gh_compas_slicer.missing_input()
# ---------- end csloadjsondata ----------
mesh_3 = Mesh(mesh_2)

# ----
panel_3 = Panel(csloadjsondata.out)
bnd = Bounds(Numbers=csloadjsondata.data)
panel_4 = Panel(csloadslicer.out)
panel_5 = Panel(csloadprintpoints.out)

mesh_4 = Mesh(csloadslicer.mesh)
paths = Curve(csloadslicer.paths)
all_points = Point(csloadslicer.all_points)

points = Point(csloadprintpoints.points)
frames = Plane(csloadprintpoints.frames)
layer_heights = Number(csloadprintpoints.layer_heights)
up_vectors = Vector(csloadprintpoints.up_vectors)
mesh_normals = Vector(csloadprintpoints.mesh_normals)
cpts = Point(csloadprintpoints.closest_support)

velocities = Number(csloadprintpoints.velocities)
wait_times = Number(csloadprintpoints.wait_times)
blend_radiuses = Number(csloadprintpoints.blend_radiuses)
extruder_toggles = Number(csloadprintpoints.extruder_toggles)

dedomain = DeconstructDomain(Domain=bnd)  # -> Start, End
gradient = Gradient(
    LowerLimit=dedomain.Start,
    UpperLimit=dedomain.End,
    Parameter=csloadjsondata.data,
    stops=[0: RGB(234, 38, 0), 0.25: RGB(234, 126, 0), 0.5: RGB(254, 244, 84), 0.75: RGB(173, 203, 249), 1: RGB(75, 107, 169)])
demesh = DeconstructMesh(Mesh=mesh_3)  # -> Vertices, Faces, Colours, Normals
ln = Line(StartPoint=points, EndPoint=cpts)
vdis = VectorDisplay(Anchor=points, Vector=expr("x*5", up_vectors))
conmesh = ConstructMesh(Vertices=demesh.Vertices, Faces=demesh.Faces, Colours=gradient)

# ---- group: Select parameter
num = Number(wait_times)

# ---- group: Visualize parameter with text
tag_offset = Slider(1, range=0..100)
pdecon = Deconstruct(Point=points)  # -> XComponent, YComponent, ZComponent
addition = Addition(A=pdecon.ZComponent, B=tag_offset)
pt = ConstructPoint(XCoordinate=pdecon.XComponent, YCoordinate=pdecon.YComponent, ZCoordinate=addition)
tag = TextTag(Location=pt, Text=num, Colour=ColourSwatch(SwatchColor=RGB(50, 130, 186)))

# ---- group: Visualize parameter with color
bnd_2 = Bounds(Numbers=num)
avr = Average(Input=num)
dedomain_2 = DeconstructDomain(Domain=bnd_2)  # -> Start, End
average = Panel(avr)
gradient_2 = Gradient(
    LowerLimit=dedomain_2.Start,
    UpperLimit=dedomain_2.End,
    Parameter=num,
    stops=[0: RGB(0, 128, 0), 0.5: RGB(255, 255, 0), 1: RGB(255, 0, 0)])
pt_2 = Point(points)
cloud = CloudDisplay(Points=pt_2, Colours=gradient_2, Size=Slider(3.96, range=0..10), SpriteType=0)

# ---- group: Slicer data
len = Length(Curve=flatten(paths))
lng = ListLength(List=flatten(paths))
sum = GhPythonScript(x=len)  # -> out, a; inputs x: list
# ---------- sum: Python ----------
__author__ = "Ioanna"
__version__ = "2020.10.25"

import rhinoscriptsyntax as rs

a = 0
for v in x:
    a += v
# ---------- end sum ----------
total_path_length = Panel(sum.a)
total_number_of_paths = Panel(lng)

# ----
min = Panel(dedomain_2.Start)
max = Panel(dedomain_2.End)
