# Grasshopper definition slicing_with_attributes.gh (Grasshopper 1.0.7)

data_folder_name = Panel("data")

# ----
# Output
# Input
py = PythonScript()  # -> path
# ---------- py: Python ----------
import sys
import os

ghComp = ghenv.Component
ghDoc = ghComp.OnPingDocument()

# the full path of the gh file
path = ghDoc.FilePath
# the current directory 
path = os.path.abspath(os.path.join(path, ".."))

print path
# ---------- end py ----------

# ---- group: Folder name
data = Data(data_folder_name)

# ---- group: Path cross-section
xz = XZPlane(Origin=Point(0, 0, 0))
rectangle = Rectangle(Plane=xz, XSize=Slider(2.5, range=0..10), YSize=Slider(1, range=0..10), Radius=Slider(0.43, range=0..1))  # -> Rectangle, Length

# ----
X = UnitX(Factor=1)

# ----
# Load Slicer
panel = Panel("slicer_data.json")
# In order for the components in this file to work, you need to add the correct folder to your paths in Rhino.
# In Rhino, type "EditPythonScript", go to Tools > Options > Add to search path and add the following folder:
# <path>/compas_slicer/src/grasshopper_visualization'
button = Button()
csloadslicer = CsLoadSlicer(recompute=button, json_name=panel, path=py, folder_name=data)  # -> out, mesh, paths, are_closed, all_points; inputs recompute: Boolean
# ---------- csloadslicer: Python ----------
"""
Loads a Slicer class from its json file in the 'output' folder.
Requires to add '<path>/compas_slicer/src/grasshopper_visualization' to your python paths.
"""

import gh_compas_slicer
gh_compas_slicer = reload(gh_compas_slicer)


if path and folder_name and json_name:
    mesh, paths, are_closed, all_points = gh_compas_slicer.load_slicer(path, folder_name, json_name)
    
else:
    gh_compas_slicer.missing_input()
# ---------- end csloadslicer ----------

# ----
# Load Printpoints
panel_2 = Panel("out_printpoints.json")
csloadprintpoints = CsLoadPrintpoints(recompute=Button(), json_name=panel_2, path=py, folder_name=data)  # -> out, geometry, points, frames, layer_heights, up_vectors, mesh_normals, closest_support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; inputs recompute: Boolean
# ---------- csloadprintpoints: Python ----------
"""
Loads a dictionaly of Printpoints from a json file in the 'output' folder.
Requires to add '<path>/compas_slicer/src/grasshopper_visualization' to your python paths.
"""

import gh_compas_slicer
gh_compas_slicer = reload(gh_compas_slicer)


if path and folder_name and json_name:
    points, frames, layer_heights, up_vectors, mesh_normals, closest_support,velocities, wait_times, \
    blend_radiuses, extruder_toggles, feasibility = \
        gh_compas_slicer.load_printpoints(path, folder_name, json_name)
    
else:
    gh_compas_slicer.missing_input()
# ---------- end csloadprintpoints ----------

# ---- group: PrintPoints
# Visualize Printpoints Attributes
# Visualization
points = Point(csloadprintpoints.points)

# ---- group: load data
panel_3 = Panel("positive_y_axis_list.json")
panel_4 = Panel("overhangs_list.json")
csloadjsondata = CsLoadJsonData(recompute=Button(), json_name="dist_from_plane_list.json", path=py, folder_name=data)  # -> out, data; inputs recompute: Boolean
# ---------- csloadjsondata: Python ----------
"""Loads a json file from the output folder. """

import gh_compas_slicer
gh_compas_slicer = reload(gh_compas_slicer)

if json_name and path and folder_name:
    data = gh_compas_slicer.load_json_file(path, folder_name, json_name)
else:
    gh_compas_slicer.missing_input()
# ---------- end csloadjsondata ----------
bnd = Bounds(Numbers=csloadjsondata.data)
dedomain = DeconstructDomain(Domain=bnd)  # -> Start, End
gradient = Gradient(
    LowerLimit=dedomain.Start,
    UpperLimit=dedomain.End,
    Parameter=csloadjsondata.data,
    stops=[0: RGB(234, 38, 0), 0.25: RGB(234, 126, 0), 0.5: RGB(254, 244, 84), 0.75: RGB(173, 203, 249), 1: RGB(75, 107, 169)])

# ---- group: Load vectors
csloadjsonvectors = CsLoadJsonVectors(recompute=Button(), json_name="direction_to_pt_list.json", path=py, folder_name=data)  # -> out, vectors; inputs recompute: Boolean
# ---------- csloadjsonvectors: Python ----------
"""
Loads a json file from the 'output' folder, 
that stores a vector field in the format: 
data['0']=[x0,y0,z0], ...,  data['N']=[xN,yN,zN]

Requires to add '<path>/compas_slicer/src/grasshopper_visualization' to your python paths.
"""

import gh_compas_slicer
gh_compas_slicer = reload(gh_compas_slicer)

if json_name and path and folder_name:
    vectors = gh_compas_slicer.load_json_vectors(path, folder_name, json_name)
else:
    gh_compas_slicer.missing_input()
# ---------- end csloadjsonvectors ----------
vdis = VectorDisplay(Anchor=points, Vector=csloadjsonvectors.vectors)

# ----
panel_5 = Panel(csloadslicer.out)
panel_6 = Panel(csloadprintpoints.out)

mesh = Mesh(csloadslicer.mesh)
paths = Curve(csloadslicer.paths)
all_points = Point(csloadslicer.all_points)

all_points_2 = Point(all_points)

points_2 = Point(csloadprintpoints.points)
frames = Plane(csloadprintpoints.frames)
layer_heights = Number(csloadprintpoints.layer_heights)
up_vectors = Vector(csloadprintpoints.up_vectors)
mesh_normals = Vector(csloadprintpoints.mesh_normals)
cpts = Point(csloadprintpoints.closest_support)

up_vectors_2 = Vector(up_vectors)
pl = ConstructPlane(Origin=all_points_2, XAxis=X, YAxis=up_vectors_2)

mesh_normals_2 = Vector(mesh_normals)
points_3 = Point(points_2)
section = Curve(rectangle.Rectangle)

print_planes = Plane(pl)
tool_mesh = Mesh(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)

# ----
# Tool Visualization
number_slider = Slider(1494, range=0..2000)
tool_origin = Panel("""0
0
99.507""")
cstoolviz = CsToolViz(origin_coords=tool_origin, mesh=tool_mesh, planes=print_planes, index=number_slider)  # -> out, mesh, passed_path; inputs origin_coords: list, mesh: Mesh, planes: list, index: Int32
# ---------- cstoolviz: Python ----------
"""
Example visualization of tool motion during the print.
Requires to add '<path>/compas_slicer/src/grasshopper_visualization' to your python paths.
"""

import gh_compas_slicer
gh_compas_slicer = reload(gh_compas_slicer)

if origin_coords and mesh and planes and (index or index==0):
    mesh, passed_path = gh_compas_slicer.tool_visualization(origin_coords, mesh, planes, index)
else:
    gh_compas_slicer.missing_input()
# ---------- end cstoolviz ----------

velocities = Number(csloadprintpoints.velocities)
wait_times = Number(csloadprintpoints.wait_times)
blend_radiuses = Number(csloadprintpoints.blend_radiuses)
extruder_toggles = Number(csloadprintpoints.extruder_toggles)
feasibility = Boolean(csloadprintpoints.feasibility)

# ----
# Ligthweight Path Visualization
number_slider_2 = Slider(2, range=0..10)
extruder_toggles_2 = Number(extruder_toggles)
all_points_3 = Point(points_2)
cslightpathviz = CsLightPathViz(
    points=all_points_3,
    extruder_toggles=extruder_toggles_2,
    domain_start=Slider(0, range=0..100),
    domain_end=Slider(1263, range=0..2000),
    pipe_diameter=number_slider_2)  # -> out, print_path_pipes, travel_path_lines; inputs points: list of Point3d, extruder_toggles: list of Boolean, domain_start: Int32, domain_end: Int32
# ---------- cslightpathviz: Python ----------
"""
Creates a lightweight visualization of the print paths. Segments with extruder_toggle=True are visualized as pipes, 
segments with extruder_toggle=False are visualized as lines.
Loads files from the 'output' folder.
Requires to add '<path>/compas_slicer/src/grasshopper_visualization' to your python paths.
"""

import gh_compas_slicer
gh_compas_slicer = reload(gh_compas_slicer)

pipe_resolution = 14

if points:
    
    # assign default values to parameters where possible. 
    if not extruder_toggles:
        extruder_toggles = [False for i in range(len(points))]
    if not domain_start:
        domain_start = 0
    if not domain_end:
        domain_end = len(points)
    if not pipe_diameter:
        pipe_diameter = 2.0
        
    print_path_pipes, travel_path_lines = \
        gh_compas_slicer.lightweight_path_visualization(points, extruder_toggles, domain_start, domain_end, pipe_diameter, pipe_resolution)
    
else:
    gh_compas_slicer.missing_input()
# ---------- end cslightpathviz ----------

# ----
# Render Path Visualization
extruder_toggles_3 = Number(extruder_toggles)
layer_heights_2 = Number(layer_heights)
up_vectors_3 = Vector(up_vectors)
python = CsRenderPathViz(
    points=points_3,
    mesh_normals=mesh_normals_2,
    layer_heights=layer_heights_2,
    up_vectors=up_vectors_3,
    extruder_toggles=extruder_toggles_3,
    cross_section=section,
    planar_printing=Toggle(True),
    compute=Toggle(False))  # -> out, loft_surfaces, travel_path_lines; inputs points: list of Point3d, mesh_normals: list of Vector3d, layer_heights: list, up_vectors: list of Vector3d, extruder_toggles: list of Boolean, cross_section: Curve, planar_printing: Boolean, compute: Boolean
# ---------- python: Python ----------
"""
Creates a render visualization of the print paths with loft surfaces where extruder_toggle=True.
For large number of points, this can take a while to compute, so keep it turned off unless you need it.
Loads files from the 'output' folder.
Requires to add '<path>/compas_slicer/src/grasshopper_visualization' to your python paths.
"""

import gh_compas_slicer
gh_compas_slicer = reload(gh_compas_slicer)

pipe_resolution = 14

if points and mesh_normals and layer_heights and extruder_toggles and cross_section:
    if compute:
        loft_surfaces, travel_path_lines = \
            gh_compas_slicer.render_path_visualization(points, mesh_normals, layer_heights, up_vectors, extruder_toggles, cross_section, planar_printing)
    else:
        print('Compute is set to False')
else:
    gh_compas_slicer.missing_input()
# ---------- end python ----------

# ---- group: Color output
geo = Geometry(cslightpathviz.travel_path_lines)
geo_2 = Geometry(cslightpathviz.print_path_pipes)
preview = CustomPreview(Geometry=geo_2, Material=ColourSwatch(SwatchColor=RGB(199, 199, 199)))
preview_2 = CustomPreview(Geometry=geo, Material=ColourSwatch(SwatchColor=RGB(255, 156, 36)))

geo_3 = Geometry(python.loft_surfaces)
geo_4 = Geometry(python.travel_path_lines)
preview_3 = CustomPreview(Geometry=geo_3, Material=ColourSwatch(SwatchColor=RGB(222, 222, 222)))
preview_4 = CustomPreview(Geometry=geo_4, Material=ColourSwatch(SwatchColor=RGB(255, 156, 36)))

# ----
mesh_2 = Mesh(cstoolviz.mesh)
geo_5 = Geometry(cstoolviz.passed_path)
preview_5 = CustomPreview(Geometry=mesh_2, Material=ColourSwatch(SwatchColor=RGB(171, 171, 171)))
preview_6 = CustomPreview(Geometry=geo_5, Material=ColourSwatch(SwatchColor=RGB(255, 156, 36)))

ln = Line(StartPoint=points_2, EndPoint=cpts)
vdis_2 = VectorDisplay(Anchor=points_2, Vector=expr("x*5", up_vectors))
cloud = CloudDisplay(Points=points, Colours=gradient, Size=Slider(3.31, range=0..10), SpriteType=0)

# ---- group: Select parameter
num = Number(wait_times)

# ---- group: Visualize parameter with text
tag_offset = Slider(1, range=0..100)
pdecon = Deconstruct(Point=points_2)  # -> XComponent, YComponent, ZComponent
addition = Addition(A=pdecon.ZComponent, B=tag_offset)
pt = ConstructPoint(XCoordinate=pdecon.XComponent, YCoordinate=pdecon.YComponent, ZCoordinate=addition)
tag = TextTag(Location=pt, Text=num, Colour=ColourSwatch(SwatchColor=RGB(50, 130, 186)))

# ---- group: Visualize parameter with color
bnd_2 = Bounds(Numbers=num)
avr = Average(Input=num)
dedomain_2 = DeconstructDomain(Domain=bnd_2)  # -> Start, End
average = Panel(avr)
gradient_2 = Gradient(
    LowerLimit=dedomain_2.Start,
    UpperLimit=dedomain_2.End,
    Parameter=num,
    stops=[0: RGB(0, 128, 0), 0.5: RGB(255, 255, 0), 1: RGB(255, 0, 0)])
pt_2 = Point(points_2)
cloud_2 = CloudDisplay(Points=pt_2, Colours=gradient_2, Size=Slider(3.96, range=0..10), SpriteType=0)

# ---- group: Slicer data
len = Length(Curve=flatten(paths))
lng = ListLength(List=flatten(paths))
ma = MassAddition(Input=len)  # -> Result, PartialResults
total_path_length = Panel(ma.Result)
total_number_of_paths = Panel(lng)

# ----
min = Panel(dedomain_2.Start)
max = Panel(dedomain_2.End)
