# Grasshopper definition visualization.gh (Grasshopper 1.0.7)

py = PythonScript()  # -> path
# ---------- py: Python ----------
import sys
import os

ghComp = ghenv.Component
ghDoc = ghComp.OnPingDocument()

# the full path of the gh file
path = ghDoc.FilePath
# the current directory 
path = os.path.abspath(os.path.join(path, ".."))

print path
# ---------- end py ----------
slicer_data = GhPythonScript(recompute=Button(), path=py, folder="data", name="slicer_data.json")  # -> out, contours, points, continuous_path_polyline
# ---------- slicer_data: Python ----------
import os
import json
import rhinoscriptsyntax as rs

filename =os.path.join(os.path.join(path), folder ,name)
print(filename)

# load data from json
with open(filename, 'r') as f:
    data = json.load(f)
print("Loaded Json: " + filename)

contours = []
points = []

if 'contours' in data:
    contours_dict = data['contours']

for i in range(len(contours_dict)):
    print (i)
    pts = contours_dict[str(i)]
    for pt in pts:
        
        # re-create points
        pt = rs.AddPoint(pt[0], pt[1], pt[2])
        points.append(pt)
        
    # create contour per layer
    try:
        contour = rs.AddPolyline(pts)
        contours.append(contour)
    except:
        pass

# create full polyline
continuous_path_polyline = rs.AddPolyline(points)
# ---------- end slicer_data ----------

crv = Curve(slicer_data.contours)
pt = Point(slicer_data.points)
crv_2 = Curve(slicer_data.continuous_path_polyline)
disc = Discontinuity(Curve=crv, Level=1)  # -> Points, Parameters
end = EndPoints(Curve=crv)  # -> Start, End
preview = CustomPreview(Geometry=crv, Material=ColourSwatch(SwatchColor=RGB(189, 189, 189)))
